# Requirement set req (R2022a)

## 1 [#1] Specifications (Container)
System Specifications

### 1.1 [#4] Soft shutdown current path to pump

### 1.2 [#5] Switch between AC & DC Inputs

### 1.3 [#6] Disable and Enable output baised on pressure, flow, power

### 1.4 [#7] Provide remote interface to system and send data to web server

### 1.5 [#11] Operate a pump

### 1.6 [#3] Operate from 100-300VDC

### 1.7 [#13] Turn pump on and off

### 1.8 [#14] AC Switchover button

## 2 [#2] System Requirements

### 2.1 [#12]